# Grasshopper definition capture-test.gh (Grasshopper 1.0.7)
# plug-ins: Sampler, Capture

number_slider = Slider(4.118, range=1..10)
number_slider_2 = Slider(4.553, range=1..10)
number_slider_3 = Slider(1.84, range=1..10)
panel = Panel("C:\Code\gh-design-space-exploration\Sampler\bin\")
panel_2 = Panel("C:\Users\harry\Desktop\New folder")
sampler = Sampler(
    Variables=[number_slider_2, number_slider, number_slider_3],
    Samples="10",
    Type=0,
    Seed="0",
    Filename="testncb-01",
    Directory=panel_2)  # -> Output, Data
domain_box = DomainBox(Base=PlaneXY(0, 0, 0), X=number_slider_2, Y=number_slider, Z=number_slider_3)
panel_3 = Panel(sampler.Output)
mass_addition = MassAddition(Input=[number_slider_2, number_slider, number_slider_3])  # -> Result, PartialResults
concatenate = Concatenate(FragmentA=mass_addition.Result, FragmentB="haha")
concatenate_2 = Concatenate(FragmentA="yesyes", FragmentB=mass_addition.Result)
capture = Capture(
    Variables=[number_slider_2, number_slider, number_slider_3],
    Objectives=mass_addition.Result,
    Mode=0,
    Properties=[concatenate, concatenate_2],
    DesignMap=panel_3,
    CsvFilename="data",
    CsvDirectory=panel_2,
    ScreenshotFilename="screenshot",
    ScreenshotDirectory=panel_2,
    BackupFrequency=0)  # -> DesignMapObjectives, CapturedProperties, Data, Images, I
panel_4 = Panel(capture.DesignMapObjectives)
panel_5 = Panel(capture.CapturedProperties)
